# Grasshopper definition importing_body_pose.gh (Grasshopper 1.0.7)

path = FilePath("D:\PROFESSIONAL\GitHub\DWPose\legs.csv")
python = GhPythonScript(file=path, entry=Slider(470, range=0..1000))  # -> out, a; inputs entry: Int32
# ---------- python: Python ----------
__author__ = "wildf"
__version__ = "2023.12.17"

import rhinoscriptsyntax as rs


def main(filename, index):
    f = open(filename, 'r')
    pts = []
    line = f.read().split("\n")[index]
    pose = line.split(",")
    for p in pose:
        point = p.split(" ")
        pts.append([float(point[0]), float(point[1]), float(point[2])])
    crvs = []
    for i in range(len(pts) - 1):
        crvs.append(rs.AddCurve([pts[i], pts[i+1]], 1))
    crvs = rs.RotateObjects(crvs,[0,0,0],180,[0,0,1])
    return crvs


a = main(file, entry)
# ---------- end python ----------
